# Grasshopper definition run_external_script.gh (Grasshopper 1.0.7)

panel = Panel("/Users/yangxiaohao/cityscapeGH/")
panel_2 = Panel("/Users/yangxiaohao/opt/anaconda3/envs/cityscapeGH/bin/python3.10")
md_slider = MDSlider(
    SliderMode=0,
    slider_value=Point(0.6567109488, 0.8659011677, 0.5),
    x_domain=Domain(-300, 300),
    y_domain=Domain(-300, 300),
    z_domain=Domain(0, 1))
panel_3 = Panel("""-83.752041
42.274896
-83.740711
42.281945""")
get_data = BooleanToggle(True)
set_environment = BooleanToggle(True)
view = BooleanToggle(True)
pdecon = Deconstruct(Point=md_slider)  # -> XComponent, YComponent, ZComponent
environment = GhPythonScript(work_directory=panel, bbox=panel_3, Run=set_environment)  # -> out, walls, b_surfs, t_surfs, roads, sidewalks, greenspaces; inputs bbox: list, Run: Boolean
# ---------- environment: Python ----------
__author__ = "yangxiaohao"

import rhinoscriptsyntax as rs
import json
import math

def latlon_to_metric(lat, lon, reference_lat):
    # Approximate conversion factors
    meters_per_degree_lat = 111320
    meters_per_degree_lon = math.cos(math.radians(reference_lat)) * meters_per_degree_lat
    x = lon * meters_per_degree_lon
    y = lat * meters_per_degree_lat
    return x, y

def buildings3D(buildings, reference_lat):
    walls = []
    b_surfs = []
    t_surfs = []

    for building in buildings:
        if building['geometry']:
            base_points = []
            for point in building['geometry']:
                x, y = latlon_to_metric(point['lat'], point['lon'], reference_lat)
                base_points += [rs.CreatePoint(x,y,0)]
            
            # Ensure there are enough points to form a polygon
            if len(base_points) >= 3:
                # Define the extrusion height
                height = building['estimated_height']
                
                # Create a base curve from the points
                base_curve = rs.AddCurve(base_points,1)
                #crvs = rs.ExplodeCurves(base_curve)
                
                # Create the top surface of buildings
                surf = rs.AddPlanarSrf(base_curve)
                
                b_surfs += surf
                t_surfs += [rs.CopyObject(surf, (0,0,height))]
                
                # Extrude the base polyline to create a wall
                wall = rs.ExtrudeCurveStraight(base_curve, (0,0,0), (0,0,height))
                walls += [wall]
    return walls, b_surfs, t_surfs
    
def road3D(roads, reference_lat):
    road_widths = {
        'primary':18,
        'secondary':15,
        'tertiary':10,
        'residential':8,
        'footway':4
    }

    road_color = rs.CreateColor((128, 64,128))
    sidewalk_color = rs.CreateColor((244, 35,232))
    
    road_surfaces = []
    sidewalk_surfaces = []
    
    for road in roads:
        #print(road['type'])
        if road['geometry'] and road['type'] in road_widths.keys():
            road_points = []
            for point in road['geometry']:
                x, y = latlon_to_metric(point['lat'], point['lon'], reference_lat)
                road_points += [rs.CreatePoint(x,y,0)]
                
            # Ensure there are enough points to form a line
            if len(road_points) >= 2:
                # Create the road centerline from the road points
                road_curv = rs.AddCurve(road_points,1)

                # Estimate the road width
                road_width = road_widths.get(road['type'], 10)
                
                # Create a buffer (offset) curve for the road width
                offset_distance = road_width / 2.0
                left_offset = rs.OffsetCurve(road_curv, [0, 0, 0], -offset_distance)
                right_offset = rs.OffsetCurve(road_curv, [0, 0, 0], offset_distance)
                
                if left_offset and right_offset:
                    left_offset_curve = left_offset[0]
                    right_offset_curve = right_offset[0]
                    
                    # Create a loft surface between the two offset curves
                    if road['type'] == 'footway':
                        sidewalk_surfaces += [rs.AddLoftSrf([left_offset_curve, right_offset_curve])]
                    else:
                        road_surfaces += [rs.AddLoftSrf([left_offset_curve, right_offset_curve])]
    return road_surfaces, sidewalk_surfaces
    
def greenspace3D(greenspaces, reference_lat):
    g_surfs = []
    
    for green in greenspaces:
        #print(green['type'])
        if green['geometry']:
            base_points = []
            for point in green['geometry']:
                x, y = latlon_to_metric(point['lat'], point['lon'], reference_lat)
                base_points += [rs.CreatePoint(x,y,0)]
            
            # Ensure there are enough points to form a polygon
            if len(base_points) >= 3:
                # Create a base curve from the points
                base_curve = rs.AddCurve(base_points,1)
                
                # Create the surface of greenspaces
                surf = rs.AddPlanarSrf(base_curve)
                g_surfs += surf
    return g_surfs

if Run:
    buildingsJson = work_directory + "temp/buildings.json"
    roadsJson = work_directory + "temp/roads.json"
    greensJson = work_directory + "temp/greens.json"
    
    # Import osm data from the JSON file
    with open(buildingsJson, 'r') as bJson:
        imported_buildings = json.load(bJson)
    with open(roadsJson, 'r') as rJson:
        imported_roads = json.load(rJson)
    with open(greensJson, 'r') as gJson:
        imported_greens = json.load(gJson)
    
    coordinates = [
        (bbox[1], bbox[0]),
        (bbox[3], bbox[2])
    ]
    reference_lat = (coordinates[0][0] + coordinates[1][0]) / 2
    reference_lon = (coordinates[0][1] + coordinates[1][1]) / 2
    center_x, center_y  = latlon_to_metric(reference_lat, reference_lon, reference_lat)

    walls, b_surfs, t_surfs = buildings3D(imported_buildings, reference_lat)
    roads, sidewalks = road3D(imported_roads, reference_lat)
    greenspaces = greenspace3D(imported_greens, reference_lat)

    direct = (-center_x, -center_y, 0)
    walls = rs.MoveObjects(walls, direct)
    b_surfs = rs.MoveObjects(b_surfs, direct)
    t_surfs = rs.MoveObjects(t_surfs, direct)
    roads = rs.MoveObjects(roads, direct)
    roads = rs.MoveObjects(roads, (0,0,0.1))
    sidewalks = rs.MoveObjects(sidewalks, direct)
    greenspaces = rs.MoveObjects(greenspaces, direct)
    
    print('done')
# ---------- end environment ----------
geo_data = GhPythonScript(python_path=panel_2, work_directory=panel, bbox=panel_3, Run=get_data)  # -> out; inputs bbox: list, Run: Boolean
# ---------- geo_data: Python ----------
__author__ = "yangxiaohao"

import os

f =  work_directory + "src/osm.py"
cmd = '%s %s --MAX_LAT %s --MAX_LON %s --MIN_LAT %s --MIN_LON %s --work_dir %s' % (python_path, f, bbox[3], bbox[2], bbox[1], bbox[0], work_directory)

if Run:
    os.system(cmd)
    print(cmd)
# ---------- end geo_data ----------
vision = GhPythonScript(
    python_path=panel_2,
    work_directory=panel,
    x=pdecon.XComponent,
    y=pdecon.YComponent,
    z=Slider(1.761, range=1..5),
    direction=Slider(268, range=0..360),
    lens=Slider(187, range=100..200),
    get_view=view)  # -> out, camera; inputs x: Int32, y: Int32, z: Int32, direction: Int32, lens: Int32, get_view: Boolean
# ---------- vision: Python ----------
__author__ = "yangxiaohao"

import rhinoscriptsyntax as rs
import os
# from Grasshopper.Kernel.Special import GH_ImageSampler
# import inspect

f =  work_directory + "src/display.py"

cmd_label = '%s %s --work_dir %s --type %s' % (python_path, f, work_directory, "label")

cmd_scene = '%s %s%stest.py --dataroot ./imgs --name pix2pix --model pix2pix --direction BtoA --gpu_ids -1 --load_size 2048 --crop_size 2048 --preprocess none --work_dir %s' % (python_path, work_directory, 'src/pix2pix_model/', work_directory)


# set camera
view = rs.CurrentView("Perspective")
rs.ViewDisplayMode(view, 'cityscape')
camera = rs.CreatePoint(int(x), int(y), z)
target = rs.CreatePoint(int(x), int(y)+5, z)
target = rs.RotateObject(target, camera, direction)

rs.ViewCamera(view, camera)
rs.ViewCameraTarget(view, camera, target)
rs.ViewCameraLens(view, lens)

# save label view
# label_f = work_directory + 'src/pix2pix_model/imgs/test/label_img.jpg'
label_f = work_directory + 'temp/label_img.jpg'
rs.Command("_-ViewCaptureToFile _Width=1024 _Height=512 " + label_f + " _Enter")

# dispaly label view
os.system(cmd_label)

# generate a scene from the label 
if get_view:
    os.system(cmd_scene)
    print(cmd_scene)
# Create a new image sampler parameter
# ghDoc = ghenv.Component.OnPingDocument()
# ghObjects = ghDoc.Objects

# for i in ghObjects:
    #if type(i) is GH_ImageSampler:
        #i.ImageFilePath = label_f

#inspect.getsource(ghc.ImageSampler)
# ---------- end vision ----------
camera_location = Point(vision.camera)
label_color = Label_color(G=[environment.walls, environment.t_surfs], label="building")
label_color_2 = Label_color(G=environment.roads, label="road")
label_color_3 = Label_color(G=environment.sidewalks, label="sidewalk")
label_color_4 = Label_color(G=environment.greenspaces, label="terrain")

# ==== cluster Label_color
label = ClusterInput()
G = ClusterInput()
cityscape_label = GhPythonScript(label=label)  # -> out, r, g, b
# ---------- cityscape_label: Python ----------
__author__ = "yangxiaohao"

labels = {
    'unlabeled':(0,0,0),
    'ego vehicle':(0,0,0),
    'rectification border':(0,0,0),
    'out of roi':(0,0,0),
    'static':(0,0,0),
    'dynamic':(111,74,0),
    'ground':(81,0,81),
    'road': (128, 64,128),
    'sidewalk':(244, 35,232),
    'parking':(250,170,160),
    'rail track':(230,150,140),
    'building':(70,70,70),
    'wall':(102,102,156),
    'fence':(190,153,153),
    'guard rail': (180,165,180),
    'bridge':(150,100,100),
    'tunnel':(150,120, 90),
    'pole':(153,153,153),
    'polegroup':(153,153,153),
    'traffic light':(250,170,30),
    'traffic sign':(220,220,0),
    'vegetation':(107,142, 35),
    'terrain':(152,251,152),
    'sky':(70,130,180),
    'person':(220, 20, 60),
    'rider':(255,0,0),
    'car':(0,0,142),
    'truck':(0,0,70),
    'bus':(0,60,100),
    'caravan':(0,0,90),
    'trailer':(0,0,110),
    'train':(0,80,100),
    'motorcycle':(0,0,230),
    'bicycle':(119,11,32),
}
if label == None:
    label = 'building'
print(labels.keys())
r,g,b = labels[label]
# ---------- end cityscape_label ----------
out = ClusterOutput(cityscape_label.out)
rgb = ColourRGB(Alpha=255, Red=cityscape_label.r, Green=cityscape_label.g, Blue=cityscape_label.b)
material = CreateMaterial(Diffuse=rgb, Specular=rgb, Emission=rgb, Transparency=0, Shine=0)
preview = CustomPreview(Geometry=G, Material=material)
